# Dynamo graph Fitting Level Change.dyn (Dynamo 2.0.3.8810)

collector_of_levels = Custom[Collector of Levels]()  # Collects Levels in the active or given document. Based on a Lunchbox node.
watch = Watch(collector_of_levels.Element)
watch_2 = Watch(collector_of_levels.Name)
code_block = CodeBlock {  }
code_block_2 = CodeBlock { Revit.Category.ByName("Duct Fittings"); }
code_block_3 = CodeBlock(x=code_block_2) { ElementQueries.OfCategory(x); }
code_block_4 = CodeBlock { Revit.Category.ByName(["Duct Fittings","Pipe Fittings","Cable Tray Fittings"]); }
code_block_5 = CodeBlock(x=code_block_4) { ElementQueries.OfCategory(x); }
flatten = List.Flatten(list=code_block_5)
elevationOfHostLevel = Custom[Element.ElevationOfHostLevel](element=flatten)  # Returns the elevation of the level a given element is associated with
code_block_6 = CodeBlock { 1; }
watch_3 = Watch(collector_of_levels.Elevation)
toMillimeters = Custom[Feet.ToMillimeters](ft=watch_3)  # Converts feet into millimeters
watch_4 = Watch(toMillimeters)
restOfItems = List.RestOfItems(list=toMillimeters)
lastItem = List.LastItem(list=restOfItems)
code_block_7 = CodeBlock(x=lastItem) { x+4000; }
addItemToEnd = List.AddItemToEnd(item=code_block_7, list=restOfItems)
watch_5 = Watch(addItemToEnd)
location = FamilyInstance.Location(familyInstance=flatten)
Z = Point.Z(point=location)
round = Math.Round(number=Z)
code_block_8 = CodeBlock(x=round) { x+4450; }
map = Math.Map(rangeMin=watch_4, rangeMax=watch_5, inputValue=code_block_8@L2, lacing=Longest)
transpose = List.Transpose(lists=map)
eq = code_block_6 == transpose
countTrue = List.CountTrue(list=eq@L2)
code_block_9 = CodeBlock(x=countTrue) { x+1; }
getItemAtIndex = List.GetItemAtIndex(list=collector_of_levels.Element, index=countTrue)
isNull = Object.IsNull(obj=getItemAtIndex, lacing=CrossProduct)
filterByBoolMask = List.FilterByBoolMask(list=flatten, mask=isNull)
filterByBoolMask_2 = List.FilterByBoolMask(list=getItemAtIndex, mask=isNull)
changeDuct_PipeFittingLevel = Custom[ChangeDuct_PipeFittingLevel](Duct_Pipe_fitting_s=filterByBoolMask.out, end_Level_s=filterByBoolMask_2.out)  # Change the level of a pipe/duct fitting(s) to another one, modifying also its offset value.
countTrue_2 = List.CountTrue(list=isNull)
code_block_10 = CodeBlock { "true"; }
eq_2 = isNull == code_block_10
filterByBoolMask_3 = List.FilterByBoolMask(list=flatten, mask=eq_2)
code_block_11 = CodeBlock { 1959; }
code_block_12 = CodeBlock(x=addItemToEnd) { x-1; }
getLocation = Element.GetLocation(element=flatten)
